# Grasshopper definition imgs_to_models.gh (Grasshopper 1.0.7)

path = FilePath("C:\Harvard\TA\circlescircuits\workshop\house_0\masks\wall_1\wall_mask.png")
list = ValueList({"No": 0, "Normalized": 1, "ToScale": 2}, selected="ToScale")
image_sampler = CSharpScript(files=path, step=Slider(15, range=0..200), normalize=Toggle(False), outPt=list)  # -> out, W, Ws, D, Ds, H, Hs, flatten(A)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; inputs files: list of String, step: Int32, normalize: Boolean, outPt: Int32
# ---------- image_sampler: C# usings ----------
using System.Drawing;
using System.Drawing.Imaging;
# ---------- image_sampler: C# ----------
    // Input configuration
    Component.Params.Input[0].Name = "File Path";
    Component.Params.Input[0].NickName = "files";
    Component.Params.Input[0].Description = "Path to image";
    Component.Params.Input[1].Name = "Sparseness";
    Component.Params.Input[1].NickName = "step";
    Component.Params.Input[1].Description = "Sample every Nth pixel (downsample). Optional, default = 1, every pixel";
    Component.Params.Input[2].Name = "Normalize";
    Component.Params.Input[2].NickName = "normalize";
    Component.Params.Input[2].Description = "Output color channels in domain of 0 to 1. Optional, default = True";
    Component.Params.Input[3].Name = "Output Points";
    Component.Params.Input[3].NickName = "outPt";
    Component.Params.Input[3].Description = "Output points or not (0: no, 1: normalized coordinates, 2: scaled coordinates). Optional, default = 0, no output";

    // Output configuration
    Component.Params.Output[1].Name = "Image Width";
    Component.Params.Output[1].NickName = "W";
    Component.Params.Output[1].Description = "Width of the input image";
    Component.Params.Output[2].Name = "Width Samples";
    Component.Params.Output[2].NickName = "Ws";
    Component.Params.Output[2].Description = "Amount of sample points in width";
    Component.Params.Output[3].Name = "Image Depth";
    Component.Params.Output[3].NickName = "D";
    Component.Params.Output[3].Description = "Depth of the input image";
    Component.Params.Output[4].Name = "Depth Samples";
    Component.Params.Output[4].NickName = "Ds";
    Component.Params.Output[4].Description = "Amount of sample points in depth";
    Component.Params.Output[5].Name = "Image Height";
    Component.Params.Output[5].NickName = "H";
    Component.Params.Output[5].Description = "Height of the input image";
    Component.Params.Output[6].Name = "Height Samples";
    Component.Params.Output[6].NickName = "Hs";
    Component.Params.Output[6].Description = "Amount of sample points in height";
    Component.Params.Output[7].Name = "Alpha Channel";
    Component.Params.Output[7].NickName = "A";
    Component.Params.Output[7].Description = "Amount of transparency [0-255 / 0-1]";
    Component.Params.Output[8].Name = "Red Channel";
    Component.Params.Output[8].NickName = "R";
    Component.Params.Output[8].Description = "Amount of red [0-255 / 0-1]";
    Component.Params.Output[9].Name = "Green Channel";
    Component.Params.Output[9].NickName = "G";
    Component.Params.Output[9].Description = "Amount of green [0-255 / 0-1]";
    Component.Params.Output[10].Name = "Blue Channel";
    Component.Params.Output[10].NickName = "B";
    Component.Params.Output[10].Description = "Amount of blue [0-255 / 0-1]";
    Component.Params.Output[11].Name = "Point3d";
    Component.Params.Output[11].NickName = "Pt";
    Component.Params.Output[11].Description = "Points of the samples";


    // Trees to store all the data
    var alphaT = new DataTree<GH_Number>();
    var redT = new DataTree<GH_Number>();
    var greenT = new DataTree<GH_Number>();
    var blueT = new DataTree<GH_Number>();
    var pointT = new DataTree<GH_Point>();

    // Setup
    if(step <= 0) step = 1;
    int xWidth = -1;
    int xCount = -1;
    int yDepth = -1;
    int yCount = -1;
    int zHeight = files.Count;
    int zCount = zHeight / step;
    if (files.Count > 0 && zCount == 0) zCount = 1;
    double factor = normalize ? 255.0 : 1;

    for (int z = 0; z < zCount; z++)
    {
      int zPos = z * step;

      // Choose image
      string file = files[zPos];

      // Load the image file
      Bitmap image = new Bitmap(file);

      // Lock the image
      Rectangle rect = new Rectangle(0, 0, image.Width, image.Height);
      BitmapData imageData = image.LockBits(rect, ImageLockMode.ReadOnly, PixelFormat.Format32bppArgb);

      // Get the address of the first line.
      IntPtr ptr = imageData.Scan0;

      // Declare an array to hold the bytes of the bitmap.
      int bytes = Math.Abs(imageData.Stride) * image.Height;
      byte[] argb = new byte[bytes];
      //BGRA

      // Copy the RGB values into the array and unlock the bits
      System.Runtime.InteropServices.Marshal.Copy(ptr, argb, 0, bytes);
      image.UnlockBits(imageData);

      // We should check here for consistency of size across images and throw if not
      if (z == 0)
      {
        xWidth = image.Width;
        xCount = xWidth / step;
        yDepth = image.Height;
        yCount = yDepth / step;
      }
      else if (image.Width != xWidth || image.Height != yDepth)
      {
        this.Component.AddRuntimeMessage(GH_RuntimeMessageLevel.Error, "All images need to have the same size");
        return;
      }


      // Sample the image
      for (int y = 0; y < yCount ; y++)
      {
        //// Use this option to respect the XY coordinates of the image.
        //// Will result in an object mirrored in XZ.
         int yPos = yDepth - 1 - y * step;

        // Use this option to "flip" the Y axis of the images.
        // Will result in an object consistent with a top view of the images.
//        int yPos = y * step;

        var path = new GH_Path(z, y);
        GH_Number[] alpha = new GH_Number[xCount];
        GH_Number[] red = new GH_Number[xCount];
        GH_Number[] green = new GH_Number[xCount];
        GH_Number[] blue = new GH_Number[xCount];
        GH_Point[] points = new GH_Point[xCount];

        for (int x = 0; x < xCount; x++)
        {
          int xPos = x * step;
          int colorIndex = ((xWidth * 4) * yPos + xPos * 4);

          blue[x] = new GH_Number(argb[colorIndex] / factor);
          green[x] = new GH_Number(argb[colorIndex + 1] / factor);
          red[x] = new GH_Number(argb[colorIndex + 2] / factor);
          alpha[x] = new GH_Number(argb[colorIndex + 3] / factor);

          switch(outPt)
          {
            case 1:
              points[x] = new GH_Point(new Point3d(
                xPos / (double) xWidth,
                yPos / (double) yDepth,
                zPos / (double) zHeight));
              break;
            case 2:
              points[x] = new GH_Point(new Point3d(
                0.5 + xPos / step,
                                0.5 - (yPos - (yDepth - 1)) / step,  // original image CS
//                0.5 + yPos / step, // flipped Y axis (see above)
                0.5 + zPos / step));
              break;
            default:
              break;
          }
        }

        alphaT.AddRange(alpha, path);
        redT.AddRange(red, path);
        greenT.AddRange(green, path);
        blueT.AddRange(blue, path);
        pointT.AddRange(points, path);
      }
    }

    // Output
    Pt = pointT;

    W = xWidth;
    Ws = xCount;
    D = yDepth;
    Ds = yCount;
    H = zHeight;
    Hs = zCount;

    R = redT;
    G = greenT;
    B = blueT;
    A = alphaT;
# ---------- end image_sampler ----------

path_2 = FilePath("C:\Harvard\TA\circlescircuits\workshop\house_0\masks\wall_1\isolated_windowpane.png")
list_2 = ValueList({"No": 0, "Normalized": 1, "ToScale": 2}, selected="ToScale")
image_sampler_2 = CSharpScript(files=path_2, step=Slider(15, range=0..200), normalize=Toggle(False), outPt=list_2)  # -> out, W, Ws, D, Ds, H, Hs, flatten(A)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; inputs files: list of String, step: Int32, normalize: Boolean, outPt: Int32; same code as image_sampler

path_3 = FilePath("C:\Harvard\TA\circlescircuits\workshop\house_0\masks\wall_1\isolated_bannister.png")
list_3 = ValueList({"No": 0, "Normalized": 1, "ToScale": 2}, selected="ToScale")
image_sampler_3 = CSharpScript(files=path_3, step=Slider(15, range=0..200), normalize=Toggle(False), outPt=list_3)  # -> out, W, Ws, D, Ds, H, Hs, flatten(A)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; inputs files: list of String, step: Int32, normalize: Boolean, outPt: Int32; same code as image_sampler

# ----
# Code Sources:
# SCI-6483 tought by Jose Luis Jose Luis Garcia del Castillo Lopez
# +
# Sophia Cabral, Mdes, 2025
panel = Panel(path)
real_image_dimensions = Panel([image_sampler.W, image_sampler.D])
sampled_image_dimensions = Panel([image_sampler.Ws, image_sampler.Ds])

panel_2 = Panel(path_2)
flatten = FlattenTree(Tree=image_sampler_2.Pt, Path="{0}")
real_image_dimensions_2 = Panel([image_sampler_2.W, image_sampler_2.D])
sampled_image_dimensions_2 = Panel([image_sampler_2.Ws, image_sampler_2.Ds])
panel_3 = Panel("212.4")
num = Number(image_sampler_2.R)

panel_4 = Panel(path_3)
flatten_2 = FlattenTree(Tree=image_sampler_3.Pt, Path="{0}")
real_image_dimensions_3 = Panel([image_sampler_3.W, image_sampler_3.D])
sampled_image_dimensions_3 = Panel([image_sampler_3.Ws, image_sampler_3.Ds])
num_2 = Number(image_sampler_3.R)

# ---- group: Channel selection
filter = StreamFilter(
    Gate=Slider(2, range=0..3),
    Stream0=image_sampler.A,
    Stream1=image_sampler.R,
    Stream2=image_sampler.G,
    Stream3=image_sampler.B)

filter_2 = StreamFilter(
    Gate=Slider(2, range=0..3),
    Stream0=image_sampler_2.A,
    Stream1=image_sampler_2.R,
    Stream2=image_sampler_2.G,
    Stream3=image_sampler_2.B)

filter_3 = StreamFilter(
    Gate=Slider(2, range=0..3),
    Stream0=image_sampler_3.A,
    Stream1=image_sampler_3.R,
    Stream2=image_sampler_3.G,
    Stream3=image_sampler_3.B)

# ---- group: Marching Squares
item = ListItem(List=image_sampler.Pt, Index=0, Wrap=True)
list_4 = ValueList({"Square": 1, "Mid": 2, "Interpolated": 3}, selected="Interpolated")
marching_square = CSharpScript(
    origin=item,
    nx=image_sampler.Ws,
    dx="1",
    ny=image_sampler.Ds,
    dy="1",
    values=filter,
    cutoff=Slider(0, range=0..256),
    type=list_4,
    bridges=Toggle(True))  # -> out, ms; inputs origin: Point3d, nx: Int32, dx: Double, ny: Int32, dy: Double, values: list of Double, cutoff: Double, type: Int32, bridges: Boolean
# ---------- marching_square: C# usings ----------
using System.Linq;
# ---------- marching_square: C# ----------
/*
    Component.Description = "A Marching Squares component";
    // Input configuration
    Component.Params.Input[0].Name = "Origin";
    Component.Params.Input[0].NickName = "origin";
    Component.Params.Input[0].Description = "Center of bottom left pixel";
    Component.Params.Input[1].Name = "Sample Width";
    Component.Params.Input[1].NickName = "nx";
    Component.Params.Input[1].Description = "Numbers of samples in the X direction";
    Component.Params.Input[2].Name = "Width Step";
    Component.Params.Input[2].NickName = "dx";
    Component.Params.Input[2].Description = "Distance between samples in the X direction";
    Component.Params.Input[3].Name = "Sample Height";
    Component.Params.Input[3].NickName = "ny";
    Component.Params.Input[3].Description = "Numbers of samples in the Y direction";
    Component.Params.Input[4].Name = "Height Step";
    Component.Params.Input[4].NickName = "dy";
    Component.Params.Input[4].Description = "Distance between samples in the Y direction";
    Component.Params.Input[5].Name = "Values";
    Component.Params.Input[5].NickName = "values";
    Component.Params.Input[5].Description = "A single list of values (ordered Y first then X)";
    Component.Params.Input[6].Name = "Iso Level";
    Component.Params.Input[6].NickName = "cutoff";
    Component.Params.Input[6].Description = "Value to determine the edge of an object";
    Component.Params.Input[7].Name = "Marching Type";
    Component.Params.Input[7].NickName = "type";
    Component.Params.Input[7].Description = "Type of marching square to draw around an object (1: Square, 2: Mid Point, 3: Interpolated) default = 1";
    Component.Params.Input[8].Name = "Build Bridges";
    Component.Params.Input[8].NickName = "bridges";
    Component.Params.Input[8].Description = "When dealing with indeterminates, should the edge prioritizing bridging the object? default = True";

    // Output configuration
    Component.Params.Output[1].Name = "Marching square";
    Component.Params.Output[1].NickName = "ms";
    Component.Params.Output[1].Description = "Result of the marching square";
*/

    bridge = bridges;
    distX = dx;
    distY = dy;
    mType = type;
    // Dictionary of mask to line generator function
    // Based on the numbering on slide
    // https://docs.google.com/presentation/d/1kWzXby5N6-MOruKcOkbxEA4MCUlvUW-X1HsVnk3VHyc/edit#slide=id.g1f5f680d851_1_406
    // This must be initialized here due to compiler order reasons...
    Dictionary<int, Func<double, double, double[], List<GH_Line>>> lineGenerator =
      new Dictionary<int, Func<double, double, double[], List<GH_Line>>>()
      {
        {0,   d0000},
        {1,   d0001},
        {2,   d0010},
        {3,   d0011},
        {4,   d0100},
        {5,   d0101},
        {6,   d0110},
        {7,   d0111},
        {8,   d1000},
        {9,   d1001},
        {10,  d1010},
        {11,  d1011},
        {12,  d1100},
        {13,  d1101},
        {14,  d1110},
        {15,  d0000},
        };

    // Store values in array for easier query, the array is 1 element large on all sides
    // fill the array with max value
    // then add the values in the center so there's a white border around the image
    // this saves calculation time, as border caps don't have to be dealt with separately
    double[,] sdf = new double[nx + 2, ny + 2];
    double max = values.Max();
    double[] temp = Enumerable.Repeat(max, (nx + 2) * (ny + 2)).ToArray();
    Buffer.BlockCopy(temp, 0, sdf, 0, sizeof (double) * (nx + 2) * (ny + 2));

    int xi = 0, yi = 0;
    for(int i = 0;i < values.Count;i++){
      if(xi >= nx)
      {
        yi++;
        xi = 0;
      }
      sdf[xi + 1, yi + 1] = values[i];
      xi++;
    }

    List<GH_Line> result = new List<GH_Line>();
    double[] weight = new double[4];

    // Loop thru the squares x→ y↑
    // skip the last row and column
    for(yi = 0;yi <= ny; yi++){
      for(xi = 0; xi <= nx; xi++){

        // Masks
        // (D)---(C)  (8)---(4)  ( )-2-( )
        //  |     |    |     |    |     |
        //  |     |    |     |    3     1
        //  |     |    |     |    |     |
        // (A)---(B)  (1)---(2)  ( )-0-( )
        int mask = 0;

        double A = sdf[xi, yi],
          B = sdf[xi + 1, yi],
          C = sdf[xi + 1, yi + 1],
          D = sdf[xi, yi + 1];

        // LB
        mask = (A <= cutoff) ? mask | 1 : mask;

        // RB
        mask = (B <= cutoff) ? mask | 2 : mask;

        // RT
        mask = (C <= cutoff) ? mask | 4 : mask;

        // LT
        mask = (D <= cutoff) ? mask | 8 : mask;

        // Weight is calculated as below
        // (x)-+->(x)       (D)--[% of (C/D)]-->(C)
        //  ↑      ↑         ↑                   ↑
        //  +      +    [% of (D/A)]        [% of (C/B)]
        //  |      |         |                   |
        // (x)-+->(x)       (A)--[% of (B/A)]-->(B)
        if((mask != 0 || mask != 16) && mType == 3)
        {
          weight[0] = distX * (cutoff - A) / (B - A);
          weight[1] = distY * (cutoff - B) / (C - B);
          weight[2] = distX * (cutoff - D) / (C - D);
          weight[3] = distY * (cutoff - A) / (D - A);
        }
        else
        {
          weight[0] = weight[2] = distX * 0.5;
          weight[1] = weight[3] = distY * 0.5;
        }

        // Line generation
        double xPos = (xi - 1) * distX + origin.X,
          yPos = (yi - 1) * distY + origin.Y;
        result.AddRange(lineGenerator[mask](xPos, yPos, weight));
      }
    }

    // Output
    ms = result;
# ---------- marching_square: C# additional code ----------
  bool bridge = false;
  double distX=1, distY = 1;
  int mType = 1;
  Point3d c(double x, double y){
    return new Point3d(x + 0.5 * distX, y + 0.5 * distY, 0);
  }

  // Always draw lines in counter-clockwise direction
  // use bridge toggle to draw indeterminates
  // ( )-S-(x)   ( )---( )   (X)---(x)
  //  |   \ |     |     |     |     |
  //  |    \E     E --- S     S --- E
  //  |     |     |     |     |     |
  // ( )---( )   (X)---(X)   ( )---( )

  List<GH_Line> d0000(double x, double y, double[] w){
    return new List<GH_Line>();
  }

  List<GH_Line> d0001(double x, double y, double[] w){
    Point3d s = new Point3d(x + w[0], y, 0);
    Point3d e = new Point3d(x, y + w[3], 0);
    switch(mType)
    {
      case 1: return new List<GH_Line>{
            new GH_Line(new Line(s, c(x, y))),
            new GH_Line(new Line(c(x, y), e))};
      default: return new List<GH_Line>{new GH_Line(new Line(s, e))};
    }
  }

  List<GH_Line> d0010(double x, double y, double[] w){
    Point3d s = new Point3d(x + distX, y + w[1], 0);
    Point3d e = new Point3d(x + w[0], y, 0);
    switch(mType)
    {
      case 1: return new List<GH_Line>{
            new GH_Line(new Line(s, c(x, y))),
            new GH_Line(new Line(c(x, y), e))};
      default: return new List<GH_Line>{new GH_Line(new Line(s, e))};
    }
  }

  List<GH_Line> d0011(double x, double y, double[] w){
    Point3d s = new Point3d(x + distX, y + w[1], 0);
    Point3d e = new Point3d(x, y + w[3], 0);
    return new List<GH_Line>{new GH_Line(new Line(s, e))};
  }

  List<GH_Line> d0100(double x, double y, double[] w){
    Point3d s = new Point3d(x + w[2], y + distY, 0);
    Point3d e = new Point3d(x + distX, y + w[1], 0);
    switch(mType)
    {
      case 1: return new List<GH_Line>{
            new GH_Line(new Line(s, c(x, y))),
            new GH_Line(new Line(c(x, y), e))};
      default: return new List<GH_Line>{new GH_Line(new Line(s, e))};
    }
  }

  // Shared center point between two lines, might join wrong line in post
  List<GH_Line> d0101(double x, double y, double[] w){
    Point3d s = new Point3d(x + w[0], y, 0);
    Point3d e = new Point3d(x, y + w[3], 0);
    Point3d ss = new Point3d(x + w[2], y + distY, 0);
    Point3d ee = new Point3d(x + distX, y + w[1], 0);
    if(bridge){
      Point3d temp = e;
      e = ee;
      ee = temp;
    }
    switch(mType)
    {
      case 1: return new List<GH_Line>{
            new GH_Line(new Line(s, c(x, y))),
            new GH_Line(new Line(c(x, y), e)),
            new GH_Line(new Line(ss, c(x, y))),
            new GH_Line(new Line(c(x, y), ee))};
      default: return new List<GH_Line>{
            new GH_Line(new Line(s, e)),
            new GH_Line(new Line(ss, ee))};
    }
  }

  List<GH_Line> d0110(double x, double y, double[] w){
    Point3d s = new Point3d(x + w[2], y + distY, 0);
    Point3d e = new Point3d(x + w[0], y, 0);
    return new List<GH_Line>{new GH_Line(new Line(s, e))};
  }

  List<GH_Line> d0111(double x, double y, double[] w){
    Point3d s = new Point3d(x + w[2], y + distY, 0);
    Point3d e = new Point3d(x, y + w[3], 0);
    switch(mType)
    {
      case 1: return new List<GH_Line>{
            new GH_Line(new Line(s, c(x, y))),
            new GH_Line(new Line(c(x, y), e))};
      default: return new List<GH_Line>{new GH_Line(new Line(s, e))};
    }
  }

  List<GH_Line> d1000(double x, double y, double[] w){
    Point3d s = new Point3d(x, y + w[3], 0);
    Point3d e = new Point3d(x + w[2], y + distY, 0);
    switch(mType)
    {
      case 1: return new List<GH_Line>{
            new GH_Line(new Line(s, c(x, y))),
            new GH_Line(new Line(c(x, y), e))};
      default: return new List<GH_Line>{new GH_Line(new Line(s, e))};
    }
  }

  List<GH_Line> d1001(double x, double y, double[] w){
    Point3d s = new Point3d(x + w[0], y, 0);
    Point3d e = new Point3d(x + w[2], y + distY, 0);
    return new List<GH_Line>{new GH_Line(new Line(s, e))};
  }

  // Shared center point between two lines, might join wrong line in post
  List<GH_Line> d1010(double x, double y, double[] w){
    Point3d s = new Point3d(x + distX, y + w[1], 0);
    Point3d e = new Point3d(x + w[0], y, 0);
    Point3d ss = new Point3d(x, y + w[3], 0);
    Point3d ee = new Point3d(x + w[2], y + distY, 0);
    if(bridge){
      Point3d temp = e;
      e = ee;
      ee = temp;
    }
    switch(mType)
    {
      case 1: return new List<GH_Line>{
            new GH_Line(new Line(s, c(x, y))),
            new GH_Line(new Line(c(x, y), e)),
            new GH_Line(new Line(ss, c(x, y))),
            new GH_Line(new Line(c(x, y), ee))};
      default: return new List<GH_Line>{
            new GH_Line(new Line(s, e)),
            new GH_Line(new Line(ss, ee))};
    }
  }

  List<GH_Line> d1011(double x, double y, double[] w){
    Point3d s = new Point3d(x + distX, y + w[1], 0);
    Point3d e = new Point3d(x + w[2], y + distY, 0);
    switch(mType)
    {
      case 1: return new List<GH_Line>{
            new GH_Line(new Line(s, c(x, y))),
            new GH_Line(new Line(c(x, y), e))};
      default: return new List<GH_Line>{new GH_Line(new Line(s, e))};
    }
  }

  List<GH_Line> d1100(double x, double y, double[] w){
    Point3d s = new Point3d(x, y + w[3], 0);
    Point3d e = new Point3d(x + distX, y + w[1], 0);
    return new List<GH_Line>{new GH_Line(new Line(s, e))};
  }

  List<GH_Line> d1101(double x, double y, double[] w){
    Point3d s = new Point3d(x + w[0], y, 0);
    Point3d e = new Point3d(x + distX, y + w[1], 0);
    switch(mType)
    {
      case 1: return new List<GH_Line>{
            new GH_Line(new Line(s, c(x, y))),
            new GH_Line(new Line(c(x, y), e))};
      default: return new List<GH_Line>{new GH_Line(new Line(s, e))};
    }
  }

  List<GH_Line> d1110(double x, double y, double[] w){
    Point3d s = new Point3d(x, y + w[3], 0);
    Point3d e = new Point3d(x + w[0], y, 0);
    switch(mType)
    {
      case 1: return new List<GH_Line>{
            new GH_Line(new Line(s, c(x, y))),
            new GH_Line(new Line(c(x, y), e))};
      default: return new List<GH_Line>{new GH_Line(new Line(s, e))};
    }
  }
# ---------- end marching_square ----------

number_slider = Slider(207.4, range=200..212)
item_2 = ListItem(List=flatten, Index=0, Wrap=True)
list_5 = ValueList({"Square": 1, "Mid": 2, "Interpolated": 3}, selected="Square")
marching_square_2 = CSharpScript(
    origin=item_2,
    nx=image_sampler_2.Ws,
    dx="1",
    ny=image_sampler_2.Ds,
    dy="1",
    values=filter_2,
    cutoff=Slider(4, range=0..215),
    type=list_5,
    bridges=Toggle(True))  # -> out, ms; inputs origin: Point3d, nx: Int32, dx: Double, ny: Int32, dy: Double, values: list of Double, cutoff: Double, type: Int32, bridges: Boolean; same code as marching_square

number_slider_2 = Slider(207.4, range=200..212)
item_3 = ListItem(List=flatten_2, Index=0, Wrap=True)
list_6 = ValueList({"Square": 1, "Mid": 2, "Interpolated": 3}, selected="Square")
marching_square_3 = CSharpScript(
    origin=item_3,
    nx=image_sampler_3.Ws,
    dx="1",
    ny=image_sampler_3.Ds,
    dy="1",
    values=filter_3,
    cutoff=Slider(4, range=0..215),
    type=list_6,
    bridges=Toggle(True))  # -> out, ms; inputs origin: Point3d, nx: Int32, dx: Double, ny: Int32, dy: Double, values: list of Double, cutoff: Double, type: Int32, bridges: Boolean; same code as marching_square

# ----
path_4 = FilePath("C:\Harvard\TA\circlescircuits\workshop\house_0\masks\wall_1\windowpane_mask.png")
list_7 = ValueList({"No": 0, "Normalized": 1, "ToScale": 2}, selected="ToScale")
image_sampler_4 = CSharpScript(files=path_4, step=Slider(15, range=0..200), normalize=Toggle(False), outPt=list_7)  # -> out, W, Ws, D, Ds, H, Hs, flatten(A)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; inputs files: list of String, step: Int32, normalize: Boolean, outPt: Int32; same code as image_sampler

panel_6 = Panel(path_4)
real_image_dimensions_4 = Panel([image_sampler_4.W, image_sampler_4.D])
sampled_image_dimensions_4 = Panel([image_sampler_4.Ws, image_sampler_4.Ds])

# ---- group: Channel selection
filter_4 = StreamFilter(
    Gate=Slider(2, range=0..3),
    Stream0=image_sampler_4.A,
    Stream1=image_sampler_4.R,
    Stream2=image_sampler_4.G,
    Stream3=image_sampler_4.B)

# ---- group: Marching Squares
item_4 = ListItem(List=image_sampler_4.Pt, Index=0, Wrap=True)
list_8 = ValueList({"Square": 1, "Mid": 2, "Interpolated": 3}, selected="Interpolated")
marching_square_4 = CSharpScript(
    origin=item_4,
    nx=image_sampler_4.Ws,
    dx="1",
    ny=image_sampler_4.Ds,
    dy="1",
    values=filter_4,
    cutoff=Slider(17.6, range=0..256),
    type=list_8,
    bridges=Toggle(True))  # -> out, ms; inputs origin: Point3d, nx: Int32, dx: Double, ny: Int32, dy: Double, values: list of Double, cutoff: Double, type: Int32, bridges: Boolean; same code as marching_square

# ----
number_slider_3 = Slider(2, range=0..10)
join = JoinCurves(Curves=marching_square_4.ms, Preserve=False)
range = Range(Domain=number_slider_3, Steps=number_slider_3)
item_5 = ListItem(List=join, Index=range, Wrap=True)
boundary = BoundarySurfaces(Edges=item_5)

path_5 = FilePath("C:\Harvard\TA\circlescircuits\workshop\house_0\masks\wall_1\bannister_mask.png")
list_9 = ValueList({"No": 0, "Normalized": 1, "ToScale": 2}, selected="ToScale")
image_sampler_5 = CSharpScript(files=path_5, step=Slider(15, range=0..200), normalize=Toggle(False), outPt=list_9)  # -> out, W, Ws, D, Ds, H, Hs, flatten(A)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; inputs files: list of String, step: Int32, normalize: Boolean, outPt: Int32; same code as image_sampler

panel_7 = Panel(path_5)
sampled_image_dimensions_5 = Panel([image_sampler_5.Ws, image_sampler_5.Ds])
real_image_dimensions_5 = Panel([image_sampler_5.W, image_sampler_5.D])

# ---- group: Channel selection
filter_5 = StreamFilter(
    Gate=Slider(2, range=0..3),
    Stream0=image_sampler_5.A,
    Stream1=image_sampler_5.R,
    Stream2=image_sampler_5.G,
    Stream3=image_sampler_5.B)

# ---- group: Marching Squares
item_6 = ListItem(List=image_sampler_5.Pt, Index=0, Wrap=True)
list_10 = ValueList({"Square": 1, "Mid": 2, "Interpolated": 3}, selected="Interpolated")
marching_square_5 = CSharpScript(
    origin=item_6,
    nx=image_sampler_5.Ws,
    dx="1",
    ny=image_sampler_5.Ds,
    dy="1",
    values=filter_5,
    cutoff=Slider(0, range=0..256),
    type=list_10,
    bridges=Toggle(True))  # -> out, ms; inputs origin: Point3d, nx: Int32, dx: Double, ny: Int32, dy: Double, values: list of Double, cutoff: Double, type: Int32, bridges: Boolean; same code as marching_square

# ----
number_slider_4 = Slider(255, range=0..1000)

# ---- group: Color
num_3 = Number(num)
bnd = Bounds(Numbers=num_3)
panel_8 = Panel("1")
dedomain = DeconstructDomain(Domain=bnd)  # -> Start, End
alpha = Slider(255, range=0..255)

# ----
num_4 = Number(panel_8)

# ---- group: Color (continued)
larger_than = CSharpScript(listA=num_3, itemB=num_4)  # -> out, gt; inputs listA: list
# ---------- larger_than: C# ----------
    List<GH_Integer> m = new List<GH_Integer>();

    double a;
    double b = (double) itemB;
    foreach (var o in listA)
    {
      a = (double) o;
      m.Add(new GH_Integer(a > b ? 1 : 0));
    }

    gt = m;
# ---------- end larger_than ----------
sift = SiftPattern(List=num_3, SiftPattern=larger_than.gt)  # -> Output0, Output1
gradient = Gradient(LowerLimit=dedomain.Start, UpperLimit=num_4, Parameter=sift.Output0, stops=[0: RGB(255, 255, 255), 1: RGB(0, 0, 0)])
gradient_2 = Gradient(
    LowerLimit=num_4,
    UpperLimit=dedomain.End,
    Parameter=sift.Output1,
    stops=[0: RGB(234, 38, 0), 0.199: RGB(234, 126, 0), 0.5: RGB(254, 244, 84), 0.75: RGB(173, 203, 249), 1: RGB(75, 107, 169)])
combine = CombineData(Input0=gradient, Input1=gradient_2)  # -> Result, Index
changealpha = CSharpScript(C=combine.Result, A=alpha)  # -> out, CA; inputs C: list, A: Int32
# ---------- changealpha: C# ----------
    int clear = 16777215; // this is 00000000 11111111 11111111 11111111
    int alpha = A << 24;

    //    var clrs = new List<System.Drawing.Color>();
    var clrs = new List<GH_Colour>();  // doing GH_Colour directly is more performative
    for (int i = 0; i < C.Count; i++)
    {
      var c = (System.Drawing.Color) C[i];
      int ci = c.ToArgb();
      ci = (ci & clear) | alpha;

      //      clrs.Add(System.Drawing.Color.FromArgb(ci));
      clrs.Add(new GH_Colour(System.Drawing.Color.FromArgb(ci)));
    }

    CA = clrs;
# ---------- end changealpha ----------
col = Colour(changealpha.CA)

# ---- group: Color Points
pt = Point(flatten)
cloud = CloudDisplay(Points=pt, Colours=col, Size=Slider(1, range=0..1), SpriteType=0)

# ---- group: Place point on color range
# Color to Point
panel_9 = Panel(col)
csv = CSharpScript(rgbInput=panel_9)  # -> out, flatten(R), flatten(G), flatten(B); inputs rgbInput: String
# ---------- csv: C# ----------
    // Split the input string by new lines
    string[] rgbLines = rgbInput.Split(new[] { '\r', '\n' }, StringSplitOptions.RemoveEmptyEntries);

    // Lists to store the R, G, and B values
    List<int> redValues = new List<int>();
    List<int> greenValues = new List<int>();
    List<int> blueValues = new List<int>();

    // Iterate through the lines and parse them
    foreach (string line in rgbLines)
    {
      string trimmedLine = line.Trim();
      if (!string.IsNullOrWhiteSpace(trimmedLine))
      {
        if (trimmedLine == "White")
        {
          // Add 255 for white
          redValues.Add(255);
          greenValues.Add(255);
          blueValues.Add(255);
        }
        else
        {
          // Split the line by commas
          string[] rgbComponents = trimmedLine.Split(',');
          if (rgbComponents.Length == 3)
          {
            int red, green, blue;
            if (int.TryParse(rgbComponents[0], out red) &&
              int.TryParse(rgbComponents[1], out green) &&
              int.TryParse(rgbComponents[2], out blue))
            {
              redValues.Add(red);
              greenValues.Add(green);
              blueValues.Add(blue);
            }
          }
        }
      }
    }

    // Assign the lists to the output parameters
    R = redValues.Count > 0 ? (object) redValues : new List<int>();
    G = greenValues.Count > 0 ? (object) greenValues : new List<int>();
    B = blueValues.Count > 0 ? (object) blueValues : new List<int>();
# ---------- end csv ----------
panel_10 = Panel(csv.R)
csv_2 = CSharpScript(initial_value=csv.B, low=Slider(186.6, range=0..1000), high=Slider(254, range=0..270))  # -> out, flatten(final_value); inputs initial_value: Double, low: Double, high: Double
# ---------- csv_2: C# ----------
    double A;

    // Check if the initial_value is between 10 and 20 (inclusive)
    if (initial_value >= low && initial_value <= high)
    {
      // If the condition is met, store the initial_value in A
      A = initial_value;
    }
    else
    {
      // If the condition is not met, store 0 in A
      A = 0;
    }

    // Assign the value of A to the output parameter final_value
    final_value = A;
# ---------- end csv_2 ----------
panel_11 = Panel(csv_2.final_value)
cull = CullPattern(List=pt, CullPattern=csv_2.final_value)
panel_12 = Panel(cull)

# ----
item_7 = ListItem(List=cull, Index=0, Wrap=True)
cir = Circle(Plane=cull, Radius=1)
tag = TextTag(Location=item_7, Text="Brightest")

# ---- group: Color
num_5 = Number(num_2)
bnd_2 = Bounds(Numbers=num_5)
panel_13 = Panel("1")
dedomain_2 = DeconstructDomain(Domain=bnd_2)  # -> Start, End
alpha_2 = Slider(255, range=0..255)

# ----
num_6 = Number(panel_13)

# ---- group: Color (continued)
larger_than_2 = CSharpScript(listA=num_5, itemB=num_6)  # -> out, gt; inputs listA: list; same code as larger_than
sift_2 = SiftPattern(List=num_5, SiftPattern=larger_than_2.gt)  # -> Output0, Output1
gradient_3 = Gradient(LowerLimit=dedomain_2.Start, UpperLimit=num_6, Parameter=sift_2.Output0, stops=[0: RGB(255, 255, 255), 1: RGB(0, 0, 0)])
gradient_4 = Gradient(
    LowerLimit=num_6,
    UpperLimit=dedomain_2.End,
    Parameter=sift_2.Output1,
    stops=[0: RGB(234, 38, 0), 0.25: RGB(234, 126, 0), 0.5: RGB(254, 244, 84), 0.75: RGB(173, 203, 249), 1: RGB(75, 107, 169)])
combine_2 = CombineData(Input0=gradient_3, Input1=gradient_4)  # -> Result, Index
changealpha_2 = CSharpScript(C=combine_2.Result, A=alpha_2)  # -> out, CA; inputs C: list, A: Int32; same code as changealpha
col_2 = Colour(changealpha_2.CA)

# ---- group: Color Points
pt_2 = Point(flatten_2)
cloud_2 = CloudDisplay(Points=pt_2, Colours=col_2, Size=Slider(0.8, range=0..1), SpriteType=0)
